# Grasshopper definition Isovist from import.gh (Grasshopper 1.0.7)

geometry_pipeline = GeometryPipeline(
    GroupByLayer=False,
    GroupByType=False,
    IncludeHidden=True,
    IncludeLocked=True,
    LayerFilter="BFN_Buildings",
    NameFilter="*",
    SublayerFiltering=True,
    TypeFilter=4)
point = Point(<point referenced from the Rhino model>)
isovist = IsoVist(Plane=point, Count=20, Radius=1500, Obstacles=geometry_pipeline)  # -> Points, Distance, Index
polyline = PolyLine(Vertices=isovist.Points, Closed=True)
scale = Scale(Geometry=flatten(polyline), Center=Point(0, 0, 0), Factor=1)  # -> Geometry, Transform
