# Grasshopper definition Pull user text from GIS import.gh (Grasshopper 1.0.7)
# plug-ins: ItemSelector, Human, EleFront, MetaHopper

# ----
# SELECT LAYER
button = Button()
layer_table = LayerTable(Update=button, AutoUpdate=False)  # -> Layers, FullLayerPaths, LayerColors, Linetypes, MaterialNames, Visible, PrintWidth, PrintColor
item_selector = ItemSelector(
    layer_table.Layers,
    {"Default", "BFN_Contours", "BFN_StreetCenter", "BFN_StreetEdge", "BFN_Buildings", "BFN_Parcels", "BFN_Boundary"}, selected="BFN_Buildings")

document_info = DocumentInfo(AutoUpdate=False, Recursive=False)  # -> DocumentName, DocumentFilePath, Components, Params, _3rdPartyAssemblies
panel = Panel(document_info._3rdPartyAssemblies)

# ----
# GET FEATURES AND ATTRIBUTES
dynamic_geometry_pipeline = DynamicGeometryPipeline(
    LayerFilter=item_selector,
    TypeFilter="All",
    NameFilter="*",
    GroupByLayer=False,
    GroupByType=False,
    IncludeHidden=True,
    IncludeLocked=True,
    enableFullPath=True,
    listenToAttributes=True)
get_user_text = GetUserText(Geometry=dynamic_geometry_pipeline)  # -> simplify(Keys), simplify(Values)
tree_branch = TreeBranch(Tree=get_user_text.Keys, Path="{0}", MaintainPaths=True)
geometry = Geometry(dynamic_geometry_pipeline)
attributes = Text(tree_branch)
values = Text(get_user_text.Values)

# ----
# QUERY FIELD
item_selector_2 = ItemSelector(
    attributes,
    {"OBJECTID", "Shape", "PIN", "PROPERTYOW", "MUNIDESC", "TAXDESC", "OWNERDESC", "STATEDESC", "USEDESC", "SALEPRICE", "FAIRMARKET", "FAIRMARK_1", "FAIRMARK_2", "STORIES", "YEARBLT", "GRADE", "GRADEDESC", "CONDITIOND", "Full_Zonin", "LegendType", "Height", "Shape_Leng", "Shape_Length", "Shape_Area"}, selected="Height")
indexof = CSharpScript(x=item_selector_2, y=attributes)  # -> out, A; inputs x: String, y: list of String
# ---------- indexof: C# ----------
    int index = -1;
    for (int i = 0; i < y.Count; i++){
      if (x.Equals(y[i])) index = i;
    }
    A = index;
# ---------- end indexof ----------
list_item = ListItem(List=values, Index=indexof.A, Wrap=True)  # -> flatten(Item)
panel_2 = Panel(list_item)
panel_3 = Panel(item_selector_2)

# ----
# STYLE FEATURES
values_2 = Number(panel_2)
geometry_2 = Geometry(geometry)
bounds = Bounds(Numbers=values_2)
boundary_surfaces = BoundarySurfaces(Edges=geometry_2)
remap_numbers = RemapNumbers(Value=values_2, Source=bounds, Target=Domain(0, 1))  # -> Mapped, Clipped
mesh_brep = MeshBrep(
    Brep=boundary_surfaces,
    Settings={GridMaxCount=0, GridMinCount=16, JaggedSeams=False, MaxEdgeLength=0, MinEdgeLength=0.0001, MinTolerance=0, Refine=True, RefineAngle=0, RelativeTolerance=0.65, SimplePlanes=True, Tolerance=0})
gradient = Gradient(
    LowerLimit=0,
    UpperLimit=1,
    Parameter=remap_numbers.Mapped,
    stops=[0: RGB(0, 128, 0), 0.5: RGB(255, 255, 0), 1: RGB(255, 0, 0)])
mesh_colours = MeshColours(Mesh=graft(mesh_brep), Colours=graft(gradient))  # -> flatten(Mesh)
mesh_join = MeshJoin(Meshes=mesh_colours)

mesh = Mesh(mesh_join)
