# Grasshopper definition blob tool.gh (Grasshopper 0.9.76)
# plug-ins: MeshEdit Components, Python Interpreter

# <<--TITLE-->
# Version:  xx.xx
# Date:        ##/##/##
# Author:     Nico Azel
number_slider = Slider(29, range=0..100)
point = Point([<point referenced from the Rhino model> x17])
point_groups = PointGroups(Points=point, Distance=number_slider)  # -> Groups, Indices
geometry = Geometry(point_groups.Groups)

param_viewer = ParamViewer(geometry)
list_length = ListLength(List=param_viewer)
series = Series(Start=0, Step=1, Count=list_length)  # -> graft(Series)
gradient = Gradient(
    LowerLimit=0,
    UpperLimit=list_length,
    Parameter=series,
    stops=[0: RGB(210, 0, 118), 0.148: RGB(103, 0, 120), 0.266: RGB(39, 72, 161), 0.407: RGB(1, 192, 229), 0.6: RGB(18, 178, 90), 0.7: RGB(79, 186, 8), 0.8: RGB(220, 237, 32), 0.9: RGB(247, 159, 20), 1: RGB(243, 57, 0)])
custom_preview = CustomPreview(Geometry=geometry, Shader=gradient)

geometry_2 = Geometry(point_groups.Groups)

range = Range(Domain="-20 to 20", Steps=Slider(8, range=0..10))
unit_z = UnitZ(Factor=range)
move = Move(Geometry=geometry_2, Motion=unit_z)  # -> Geometry, Transform

geometry_3 = Geometry(geometry_2)
metaball_t = MetaBallT(Points=geometry_3, Plane=move.Geometry, Threshold=Slider(0.01, range=0..0.01), Accuracy=Slider(1, range=0..10))  # -> simplify(Isocurve)

path_mapper = PathMapper(metaball_t, source="{a;b}", target="{a}")
divide_curve = DivideCurve(Curve=path_mapper, Count=10, Kinks=False)  # -> Points, Tangents, Parameters
path_mapper_2 = PathMapper(divide_curve.Points, source="{a;b}", target="{a}")
_3d_convexhull = _3DConvexHull(Points=path_mapper_2)

geometry_4 = Geometry(geometry_2)
average = Average(Input=geometry_4)
metaball_t_2 = MetaBallT(Points=geometry_4, Plane=average, Threshold=Slider(0.01, range=0..0.01), Accuracy=Slider(1, range=0..10))  # -> simplify(Isocurve)

number_slider_2 = Slider(3, range=0..10)
smooth_mesh = SmoothMesh(Mesh=_3d_convexhull, Strength=Slider(1, range=0..1), SkipNaked=True, Iterations=1)
mergeotherbranches = PythonScript(inTree=smooth_mesh)  # -> out, outTree; inputs inTree: tree
# ---------- mergeotherbranches: Python ----------
#Written by Nicolas Azel
###<<<<-----------//[:]\\----------->>>>####
###---<<import Key Librarys>>---###
import Grasshopper.DataTree as datatree #for using data trees 
import System # for creating new objects
import Grasshopper.Kernel.Data.GH_Path as ghpath #for managing paths easily
###---<<Produce Output Trees>>---###
newTree = datatree[System.Object]()

paths = inTree.Paths
for path in paths:
    for otherPath in paths:
        if path != otherPath:
            newTree.AddRange(inTree.Branch(otherPath),path)
outTree = newTree
# ---------- end mergeotherbranches ----------
deconstruct_mesh = DeconstructMesh(Mesh=mergeotherbranches.outTree)  # -> Vertices, Faces, Colours, Normals
number_slider_3 = Slider(10, range=0..10)
unit_z_2 = UnitZ(Factor=Slider(0.5, range=0..1))
path_mapper_3 = PathMapper(deconstruct_mesh.Vertices, source="{a;b}", target="{a}")
custom_preview_2 = CustomPreview(Geometry=smooth_mesh, Shader=ColourSwatch(SwatchColor=RGB(136, 173, 178)))
extrude = Extrude(Base=metaball_t_2, Direction=unit_z_2)
populate_3d = Populate3D(Region=smooth_mesh, Count=Slider(15, range=0..100), Seed=1)
cap_holes = CapHoles(Brep=extrude)
mesh_inclusion = MeshInclusion(Mesh=smooth_mesh, Point=populate_3d, Strict=False)
custom_preview_3 = CustomPreview(Geometry=cap_holes, Shader=ColourSwatch(SwatchColor=RGB(72, 116, 199)))
divide_curve_2 = DivideCurve(Curve=metaball_t_2, Count=10, Kinks=False)  # -> Points, Tangents, Parameters
cull_pattern = CullPattern(List=populate_3d, CullPattern=mesh_inclusion)
point_2 = Point(divide_curve_2.Points)
deconstruct = Deconstruct(Point=cull_pattern)  # -> XComponent, YComponent, ZComponent
closest_point = ClosestPoint(Point=point_2, Cloud=path_mapper_3)  # -> ClosestPoint, CPIndex, Distance
construct_point = ConstructPoint(XCoordinate=deconstruct.XComponent, YCoordinate=deconstruct.YComponent, ZCoordinate=0)
line = Line(StartPoint=point_2, EndPoint=closest_point.ClosestPoint)
circle_cnr = CircleCNR(Center=construct_point, Normal=Vector(0, 0, 1), Radius=Slider(2, range=0..10))
divide_curve_3 = DivideCurve(Curve=line, Count=Slider(3, range=0..10), Kinks=False)  # -> simplify(flatten(Points)), Tangents, Parameters
unit_z_3 = UnitZ(Factor=Slider(20, range=0..100))
negative = Negative(Value=unit_z_3)
construct_point_2 = ConstructPoint(XCoordinate=0, YCoordinate=0, ZCoordinate=0)

range_2 = Range(Domain="1 to 5", Steps=Slider(9, range=0..10))
unit_z_4 = UnitZ(Factor=range_2)
move_2 = Move(Geometry=construct_point_2, Motion=unit_z_4)  # -> Geometry, Transform

extrude_2 = Extrude(Base=circle_cnr, Direction=negative)

geometry_5 = Geometry(divide_curve_3.Points)
metaball_t_3 = MetaBallT(Points=geometry_5, Plane=move_2.Geometry, Threshold=Slider(0.4, range=0..1), Accuracy=Slider(1, range=0..10))  # -> simplify(Isocurve)

custom_preview_4 = CustomPreview(Geometry=extrude_2, Shader=ColourSwatch(SwatchColor=RGB(245, 51, 51)))
boundary_surfaces = BoundarySurfaces(Edges=metaball_t_3)
create_material = CreateMaterial(
    Diffuse=RGB(255, 105, 180),
    Specular=RGB(255, 255, 255),
    Emission=ColourSwatch(SwatchColor=RGB(168, 118, 118)),
    Transparency=0,
    Shine=0)
custom_preview_5 = CustomPreview(Geometry=boundary_surfaces, Shader=create_material)
