# Grasshopper definition Geenerative Urban Planning.gh (Grasshopper 1.0.7)
# plug-ins: MeerkatGIS

shapefile = ImportShapefile(OnOff=Toggle(True))
path = FilePath("C:\Users\659\Documents\GitHub\ArcRhino\UseCase\BFN_Buildings.mkgis")

# ---- group: GET VACANT PLOTS
path_2 = FilePath("C:\Users\659\Documents\GitHub\ArcRhino\UseCase\BFN_Parcels.mkgis")
parse_mkgis = ParseMeerkatFile(MeerkatFile=path_2)  # -> DateCropped, UserAndMachineNamed, PathForFiles, ShapeType, ShapeCountInSource, BoundsInPointSpace, BoundsInLatLong, FieldNames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
geo = Geometry(parse_mkgis.GeometryPerShape)
pline = PolyLine(Vertices=geo, Closed=False)
area = Area(Geometry=pline)  # -> Area, Centroid
ins = InsertItems(List=parse_mkgis.FieldValuesPerShape, Item=pline, Indices=Slider(104, range=0..1000), Wrap=True)
filter = GhPythonScript(tree=ins)  # -> out, a; inputs tree: tree
# ---------- filter: Python ----------
__author__ = "ek542"
__version__ = "2019.10.19"

import rhinoscriptsyntax as rs
from System import Object
import Grasshopper.Kernel as gh
from Grasshopper import DataTree
from Grasshopper.Kernel.Data import GH_Path

tree_new = DataTree[Object]()
count = 0

for i in range(tree.BranchCount):
    branch = tree.Branch(i)
    use_desc = branch[38]
    if ("VACANT" in use_desc):
         path = GH_Path(count)
         for item in branch:
            tree_new.Add(item, path)
         count +=  1

a = tree_new
# ---------- end filter ----------

# ----
parse_mkgis_2 = ParseMeerkatFile(MeerkatFile=path)  # -> DateCropped, UserAndMachineNamed, PathForFiles, ShapeType, ShapeCountInSource, BoundsInPointSpace, BoundsInLatLong, FieldNames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

# ----
# Data Set File Paths Or Source Directory: Data from A22 Project should be present in the Rhino File
rhino_files_associated_with_script = Panel("Bloomfield_mapping_layers_v01")
class_plug_in_library = Panel("\\GoogleDrive\_X_Refrance\Gh_Plugins")

path_3 = FilePath("C:\Users\659\Documents\GitHub\ArcRhino\UseCase\BFN_StreetEdge.mkgis")
parse_mkgis_3 = ParseMeerkatFile(MeerkatFile=path_3)  # -> DateCropped, UserAndMachineNamed, PathForFiles, ShapeType, ShapeCountInSource, BoundsInPointSpace, BoundsInLatLong, FieldNames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
pt = Point(parse_mkgis_2.GeometryPerShape)
panel = Panel(parse_mkgis_2.FieldNames)
pline_2 = PolyLine(Vertices=parse_mkgis_2.GeometryPerShape, Closed=Toggle(True))
ins_2 = InsertItems(List=parse_mkgis_2.FieldValuesPerShape, Item=pline_2, Indices=Slider(21, range=0..100), Wrap=True)
pline_3 = PolyLine(Vertices=parse_mkgis_3.GeometryPerShape, Closed=False)
number_slider = Slider(3, range=0..8)

item = ListItem(List=filter.a, Index=Slider(104, range=0..1000), Wrap=True)  # -> Item1, Item
geo_2 = Geometry(item.Item)
runion = RegionUnion(Curves=flatten(geo_2))
area_2 = Area(Geometry=runion)  # -> Area, Centroid
item_2 = ListItem(List=runion, Index=number_slider, Wrap=True)

path_4 = FilePath("C:\DIVA\WeatherData\USA_NY_New.York-LaGuardia.AP.725030_TMY3.epw")
ladybug = Ladybug_Ladybug()  # -> Vviiiiiiiiiizzz; plug-in component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
gencumulativeskymtx = Ladybug_GenCumulativeSkyMtx(epwFile=path_4, skyDensity=0, useOldRes=True, runIt=Toggle(True))  # -> readMe, cumulativeSkyMtx; plug-in component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
doy_hoy = Ladybug_DOY_HOY(days=Slider(21, range=1..31), months=Slider(7, range=1..12), hours=Slider(12, range=0..23))  # -> HOY, DOY, date; plug-in component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
selectskymtx = Ladybug_selectSkyMtx(cumulativeSkyMtx=gencumulativeskymtx.cumulativeSkyMtx, HOY=doy_hoy.HOY, removeDiffuse=False, removeDirect=False)  # -> readMe, selectedSkyMtx; plug-in component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
geometry = Geometry(runion)
item_3 = ListItem(List=parse_mkgis_2.FieldValuesPerShape, Index="18", Wrap=True)  # -> flatten(Item)
Z = UnitZ(Factor=item_3)
extr = Extrude(Base=flatten(pline_2), Direction=Z)
boundary = BoundarySurfaces(Edges=geometry)  # -> flatten(Surfaces)
toggle = BooleanToggle(False)
toggle_2 = BooleanToggle(False)
cap = CapHoles(Brep=extr)
flip = Flip(Surface=boundary)  # -> Surface, Result
viewanalysis = Ladybug_ViewAnalysis(
    geometry=flatten(flip.Surface),
    context=flatten(cap),
    gridSize="5",
    disFromBase="0.1",
    viewTypeOrPoints=flatten("4"),
    parallel=toggle_2,
    runIt=toggle_2)  # -> readMe, contextMesh, analysisMesh, testPts, testVec, viewVec, port, viewStudyResult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; plug-in component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
radiationanalysis = Ladybug_RadiationAnalysis(
    geometry=flatten(flip.Surface),
    context=flatten(cap),
    gridSize="5",
    disFromBase="0.1",
    selectedSkyMtx=flatten(selectskymtx.selectedSkyMtx),
    parallel=toggle,
    runIt=toggle)  # -> readMe, contextMesh, analysisMesh, testPts, testVec, port, radiationResult, radiationMesh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; plug-in component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
data = Data(Tree({0}: [0.4348177256, 0.4348177256, 0.36791015, 0.36791015, 0.425641648, 0.4247816738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], {1}: [0.4524228875, 0.4654864871, 0.4472258019, 0.4625635835, 0.4452890259, 0.4633722271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], {2}: [0.4736964822, 0.4617080053, 0.4291234918, 0.4717005332, 0.4572288692, 0.4248535662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], {3}: [0.4986548595, 0.5006170394, 0.5007692647, 0.5006170394, 0.4996638045, 0.5004032666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], {4}: [0.4215262881, 0.4553508973, 0.4731863853, 0.4624575889, 0.4189564604, 0.454868613, 0.4593049464, 0.4563450703, 0.4361851727, 0.4563045886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], {5}: [0.4337684738, 0.4529800331, 0.4277252918, 0.4476169862, 0.4269434656, 0.4458479351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], {6}: [0.4225024294, 0.4348779545, 0.4436812743, 0.4480549078, 0.4503855827, 0.4387590549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], {7}: [0.4459243815, 0.4121810255, 0.1005633651, 0, 0.1797942662, 0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], {8}: [0, 0, 0, 0, 0, 0, 0, 0.4163509176, 0.4388498875, 0.4554719702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]))
data_2 = Data(Tree({0}: [63.3266049, 63.3266049, 66.81720381, 66.21982057, 60.19763348, 59.78885542, 69.30752388, 69.30752388, 53.34099982, 69.86091744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], {1}: [75.4439047, 79.86526882, 72.60416428, 78.12800834, 71.39522893, 78.6814019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], {2}: [81.380834, 76.97859232, 67.37774254, 79.76312059, 74.25839896, 64.65754918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], {3}: [91.27039849, 92.28778227, 92.43239777, 92.28778227, 91.67917655, 92.08795461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], {4}: [59.19233557, 71.00675168, 78.67294917, 75.45888158, 57.43000665, 70.15585104, 73.13969858, 73.10153849, 63.11911014, 70.26712201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], {5}: [68.83227379, 73.49326448, 65.5034747, 70.63327118, 64.08558894, 69.47127189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], {6}: [58.28896796, 62.56225606, 64.26557402, 66.74777963, 67.97411382, 64.16688631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], {7}: [66.67315208, 59.64839646, 39.59215117, 0, 42.28662191, 0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], {8}: [0, 0, 0, 0, 0, 0, 0, 49.78302154, 57.67989126, 65.3606202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]))
avr = Average(Input=data)  # -> flatten(ArithmeticMean)
bnd = Bounds(Numbers=avr)
avr_2 = Average(Input=data_2)  # -> flatten(ArithmeticMean)
dedomain = DeconstructDomain(Domain=bnd)  # -> Start, End
bnd_2 = Bounds(Numbers=avr_2)
subtraction = Subtraction(A=dedomain.End, B=dedomain.Start)
dedomain_2 = DeconstructDomain(Domain=bnd_2)  # -> Start, End
multiplication = Multiplication(A=subtraction, B="0.5")
multiplication_2 = Multiplication(A=subtraction, B="0.7")
dom = ConstructDomain(DomainStart=dedomain_2.End, DomainEnd=dedomain_2.Start)
neg = Negative(Value=multiplication)
remap = RemapNumbers(Value=avr_2, Source=bnd_2, Target=dom)  # -> Mapped, Clipped
dom_2 = ConstructDomain(DomainStart=neg, DomainEnd=multiplication)
bnd_3 = Bounds(Numbers=remap.Mapped)
remap_2 = RemapNumbers(Value=avr, Source=Domain(0, 1), Target=dom_2)  # -> Mapped, Clipped
abs = Absolute(Value=remap_2.Mapped)
item_4 = ListItem(List=remap.Mapped, Index=number_slider, Wrap=True)
bnd_4 = Bounds(Numbers=abs)
item_5 = ListItem(List=abs, Index=number_slider, Wrap=True)
remap_3 = RemapNumbers(Value=item_4, Source=bnd_3, Target=Domain(0, 1))  # -> Mapped, Clipped
remap_4 = RemapNumbers(Value=item_5, Source=bnd_4, Target=Domain(0, 1))  # -> Mapped, Clipped

join = JoinCurves(Curves=flatten(pline_3), Preserve=False)
graft = GraftTree(Tree=area_2.Centroid, IncludeEmptyLists=True, IncludeNullItems=True)

merge = Merge(Data1=pline_2)  # -> flatten(Result)

# ---- group: Generate Isovist / Buildings grouped by Vacant Parcel that it is close to
geometry_2 = Geometry(merge)

# ----
preview = CustomPreview(Geometry=cap, Material=ColourSwatch(SwatchColor=RGB(255, 255, 255)))

# ---- group: Generate Isovist
number_slider_2 = Slider(50, range=0..100)
number_slider_3 = Slider(100, range=1..5000)

# ---- group: Generate Isovist / get Centerpoint of vacant lot
point = Point(area_2.Centroid)

# ----
xy = XYPlane(Origin=point)

# ---- group: 50
addition = Addition(A=dedomain.Start, B=multiplication)

# ----
rotate = Rotate(Geometry=xy, Angle=degrees(Slider(10, range=0..10)), Plane=xy)  # -> Geometry, Transform

# ---- group: Generate Isovist
isovist = IsoVist(Plane=rotate.Geometry, Count=number_slider_2, Radius=number_slider_3, Obstacles=geometry_2)  # -> Points, Distance, Index

# ----
item_6 = ListItem(List=parse_mkgis_2.FieldValuesPerShape, Index=Slider(5, range=0..10), Wrap=True)  # -> flatten(Item)

# ---- group: Generate Isovist / View Lines
line = Line(StartPoint=graft(point), EndPoint=isovist.Points)

# ---- group: Generate Isovist / Parimiter Line
polyline = PolyLine(Vertices=isovist.Points, Closed=True)

# ----
panel_2 = Panel(item_6)
python = GhPythonScript(x=item_6)  # -> out, a
# ---------- python: Python ----------
__author__ = "659"
__version__ = "2019.10.19"

import rhinoscriptsyntax as rs

lst = []

for i in range(len(x)):
    strg = x[i] + ""
    if ("COMMERCIAL" in strg):
        lst.append(0)
    else: 
        lst.append(1)
a = lst
# ---------- end python ----------
tmatch = MatchText(Text=panel_2, RegEx="COMMERCIAL", Case=True)

geometry_3 = Geometry(polyline)
custom_preview = CustomPreview(Geometry=geometry_3, Shader=ColourSwatch(SwatchColor=RGB(255, 136, 0)))

geometry_4 = Geometry(line)
custom_preview_2 = CustomPreview(Geometry=geometry_4, Shader=ColourSwatch(SwatchColor=RGBA(177, 199, 157, 67)))

panel_3 = Panel(tmatch)
area_3 = Area(Geometry=geometry_3)  # -> flatten(Area), Centroid
bnd_5 = Bounds(Numbers=area_3.Area)
dedomain_3 = DeconstructDomain(Domain=bnd_5)  # -> Start, End
item_7 = ListItem(List=area_3.Area, Index=number_slider, Wrap=True)
dom_3 = ConstructDomain(DomainStart=dedomain_3.End, DomainEnd=dedomain_3.Start)
remap_5 = RemapNumbers(Value=item_7, Source=bnd_5, Target=dom_3)  # -> Mapped, Clipped
remap_6 = RemapNumbers(Value=item_7, Source=dom_3, Target=Domain(0, 1))  # -> Mapped, Clipped
item_8 = ListItem(List=flatten(cap), Index=number_slider, Wrap=True)
boundary_2 = BoundarySurfaces(Edges=item_2)
preview_2 = CustomPreview(Geometry=boundary_2, Material=ColourSwatch(SwatchColor=RGB(247, 0, 255)))
multiplication_3 = Multiplication(A=remap_4.Mapped, B="0.3")
multiplication_4 = Multiplication(A=remap_3.Mapped, B="0.3")
multiplication_5 = Multiplication(A=remap_6.Mapped, B=0.1)
galapagos = Galapagos(fitness=ma_4, gene=number_slider)

# ---- group: HEIGHTS
item_9 = ListItem(List=ins_2, Index=Slider(21, range=0..100), Wrap=True)  # -> flatten(Item)
area_4 = Area(Geometry=item_9)  # -> Area, Centroid
max_distance = Slider(200, range=0..1000)
item_10 = ListItem(List=parse_mkgis_2.FieldValuesPerShape, Index=Slider(18, range=0..20), Wrap=True)
trunc = Truncate(Input=item_10, TruncationFactor="0.9")  # -> flatten(Result)

# ---- group: HEIGHTS / Iterate
dist = Distance(PointA=graft, PointB=area_4.Centroid)

# ---- group: HEIGHTS (continued)
larger = LargerThan(FirstNumber=dist, SecondNumber=max_distance)  # -> LargerThan, OrEqualTo
heights = Dispatch(List=trunc, DispatchPattern=larger.LargerThan)  # -> ListA, ListB
distance = Dispatch(List=dist, DispatchPattern=larger.LargerThan)  # -> ListA, ListB

# ----
heights_2 = Dispatch(DispatchPattern=larger.LargerThan)  # -> ListA, ListB
heights_3 = Dispatch(List=item_6, DispatchPattern=larger.LargerThan)  # -> ListA, ListB
panel_4 = Panel(distance.ListB)

# ---- group: HEIGHTS / WEIGHTED AVERAGE
ma = MassAddition(Input=distance.ListB)  # -> Result, PartialResults
division = Division(A=distance.ListB, B=ma.Result)
multiplication_6 = Multiplication(A=heights.ListB, B=division)
ma_2 = MassAddition(Input=multiplication_6)  # -> Result, PartialResults

# ----
panel_5 = Panel(heights_3.ListA)
bnd_6 = Bounds(Numbers=flatten(ma_2.Result))
item_11 = ListItem(List=flatten(ma_2.Result), Index=number_slider, Wrap=True)
remap_7 = RemapNumbers(Value=item_11, Source=bnd_6, Target=Domain(0, 1))  # -> Mapped, Clipped
heights_4 = Dispatch(List=tmatch, DispatchPattern=larger.LargerThan)  # -> ListA, ListB
bool = Boolean(heights_4.ListB)
ma_3 = MassAddition(Input=bool)  # -> flatten(Result), PartialResults
bnd_7 = Bounds(Numbers=ma_3.Result)
item_12 = ListItem(List=ma_3.Result, Index=number_slider, Wrap=True)
remap_8 = RemapNumbers(Value=item_12, Source=bnd_7, Target=Domain(0, 1))  # -> Mapped, Clipped
geo_3 = Geometry(heights_2.ListA)
geo_4 = Geometry(heights_2.ListB)
preview_3 = CustomPreview(Geometry=geo_4, Material=ColourSwatch(SwatchColor=RGB(196, 196, 196)))
preview_4 = CustomPreview(Geometry=geo_3, Material=ColourSwatch(SwatchColor=RGB(255, 255, 255)))
multiplication_7 = Multiplication(A=remap_8.Mapped, B="0.2")
multiplication_8 = Multiplication(A=remap_7.Mapped, B="0.1")
ma_4 = MassAddition(Input=[multiplication_3, multiplication_4, multiplication_8, multiplication_5, multiplication_7])  # -> Result, PartialResults
