# Grasshopper definition Lab6 - Isovist Generation.gh (Grasshopper 0.9.76)
# plug-ins: Human, EleFront, MetaHopper

docinfo = DocumentInfo(AutoUpdate=False, Recursive=False)  # -> DocumentName, DocumentFilePath, Components, Params, _3rdPartyAssemblies
plugins = Panel(docinfo._3rdPartyAssemblies)
name = Panel(docinfo.DocumentName)
file_path = Panel(docinfo.DocumentFilePath)

# ----
# Rhino File's
# Data Set's Used
# Data Set File Paths Or Source Directory: Data from A22 Project should be present in the Rhino File
rhino_files_associated_with_script = Panel("Bloomfield_mapping_layers_v01")

# ----
# <SCRIPT TITLE>
# 
# Project # : ||||||||||||||||||||||
# Script Author: |||||||||||||||||
# Date Created: MM/DD/YY
# Script Discription
# Plug-in Dependancy
class_plug_in_library = Panel("\\GoogleDrive\_X_Refrance\Gh_Plugins")

# ---- group: Select Vacant Lots by User Attribute
reference_by_user_atributes = ReferenceByUserAtributes(Key="USEDESC", Val="VACANT LAND")

# ---- group: Vacant Lots
geometry = Geometry(reference_by_user_atributes)

# ---- group: Select only vancant parcels greater than a particulare size
# Sort Out large vacant lots
geometry_2 = Geometry(geometry)
area = Area(Geometry=geometry_2)  # -> Area, Centroid
ft_arc = Panel("43560")
division = Division(A=area.Area, B=ft_arc)
bounds = Bounds(Numbers=division)
larger_than = LargerThan(FirstNumber=division, SecondNumber=Slider(0.5, range=0..3))  # -> LargerThan, OrEqualTo
parcel_size_range = Panel(bounds)
cull_pattern = CullPattern(List=geometry_2, CullPattern=larger_than.LargerThan)

# ---- group: Big Vacant Lots
geometry_3 = Geometry(cull_pattern)

# ----
# Import buildings
reference_by_layer = ReferenceByLayer(LayerName="Buildings_noData")

# ---- group: Big Vacant Lots
# Graft to treat each lot indipendently
geometry_4 = Geometry(simplify(graft(geometry_3)))

# ---- group: Building footprints layer
geometry_5 = Geometry(reference_by_layer)

# ----
boundary_surfaces = BoundarySurfaces(Edges=geometry_4)

# ---- group: Big Vacant Lots
geometry_6 = Geometry(boundary_surfaces)

# ----
custom_preview = CustomPreview(Geometry=geometry_6, Shader=ColourSwatch(SwatchColor=RGB(82, 184, 81)))

# ---- group: Big Vacant Lots
geometry_7 = Geometry(geometry_4)

# ---- group: Buildings
# Select Buildings near vacant lots  (to reduce isovist computation time)
geometry_8 = Geometry(geometry_5)

# ---- group: Big Vacant Lots
# Preview vacant lots
geometry_9 = Geometry(geometry_4)

# ----
custom_preview_lineweights = CustomPreviewLineweights(
    Geometry=geometry_9,
    Shader=ColourSwatch(SwatchColor=RGB(130, 194, 103)),
    Thickness=Slider(3, range=0..10),
    Absolute=False)

# ---- group: Generate Isovist / Big Vacant Lots
geometry_10 = Geometry(geometry_4)

# ---- group: Generate Isovist / get Centerpoint of vacant lot
# Generate Isovist
area_2 = Area(Geometry=geometry_10)  # -> Area, Centroid
point = Point(area_2.Centroid)

# ---- group: Generate Isovist
number_slider = Slider(648, range=1..5000)
number_slider_2 = Slider(40, range=0..100)

# ----
geometry_11 = Geometry(geometry_8)
area_3 = Area(Geometry=geometry_11)  # -> Area, Centroid
area_4 = Area(Geometry=geometry_7)  # -> Area, Centroid
distance = Distance(PointA=area_3.Centroid, PointB=area_4.Centroid)

# ---- group: Distance between points and buildings
data = Data(distance)

# ----
smaller_than = SmallerThan(FirstNumber=data, SecondNumber=Slider(959, range=1..5000))  # -> SmallerThan, OrEqualTo

cull_pattern_2 = CullPattern(List=geometry_8, CullPattern=smaller_than.SmallerThan)

# ---- group: Buildings grouped by Vacant Parcel that it is close to
geometry_12 = Geometry(cull_pattern_2)

# ---- group: Generate Isovist / Buildings grouped by Vacant Parcel that it is close to
geometry_13 = Geometry(geometry_12)

# ---- group: Buildings grouped by Vacant Parcel that it is close to
# Preview Buildings
geometry_14 = Geometry(geometry_12)

# ----
custom_preview_2 = CustomPreview(Geometry=geometry_14, Shader=ColourSwatch(SwatchColor=RGB(82, 90, 247)))

# ---- group: Generate Isovist
isovist = IsoVist(Plane=point, Count=number_slider_2, Radius=number_slider, Obstacles=geometry_13)  # -> Points, Distance, Index

# ---- group: Generate Isovist / Parimiter Line
polyline = PolyLine(Vertices=isovist.Points, Closed=True)

# ---- group: Generate Isovist / View Lines
line = Line(StartPoint=point, EndPoint=isovist.Points)

# ----
geometry_15 = Geometry(polyline)
custom_preview_3 = CustomPreview(Geometry=geometry_15, Shader=ColourSwatch(SwatchColor=RGB(255, 136, 0)))

# ----
# Preivew isovist
geometry_16 = Geometry(line)
custom_preview_4 = CustomPreview(Geometry=geometry_16, Shader=ColourSwatch(SwatchColor=RGBA(177, 199, 157, 67)))
